# Grasshopper definition 260426_seq 5.gh (Grasshopper 1.0.8)
# plug-ins: RhinoCodePluginGH, EleFront, eleFront

toggle = BooleanToggle(False)
reflay = ReferenceByLayer(LayerName="REF", lightweight=False)  # -> flatten(Geometry)
reflay_2 = ReferenceByLayer(LayerName="sequence::*", lightweight=False)  # -> flatten(Geometry)
rhatt = GetRhinoAttributes(Geometry=reflay)  # -> Name, Layer, Color
volume = Volume(Geometry=reflay)  # -> Volume, Centroid
rhatt_2 = GetRhinoAttributes(Geometry=reflay_2)  # -> Name, Layer, Color
hxl_volume = Integer(volume.Volume)
hxl_colour = Data(rhatt.Color)
data = Data(reflay_2)
txt = Text(rhatt_2.Layer)
cset = CreateSet(List=txt)  # -> Set, Map
txt_2 = Text(txt)
split = TextSplit(Text=txt_2, Separators="_")  # -> simplify(Result)
split_2 = TextSplit(Text=cset.Set, Separators="_")  # -> simplify(Result)
int = Integer()
dispatch = Dispatch(List=split_2, DispatchPattern=[True, False])  # -> ListA, flatten(ListB)
dispatch_2 = Dispatch(List=split, DispatchPattern=[True, False])  # -> ListA, flatten(ListB)
sort = SortList(Keys=dispatch.ListB, ValuesA=dispatch.ListB)  # -> Keys, ValuesA
data_2 = Data(simplify(graft(sort.ValuesA)))
data_3 = Data(dispatch_2.ListB)
mindex = MemberIndex(Set=data_3, Member=data_2)  # -> simplify(Index), Count
data_4 = Data(data)
item = ListItem(List=data_4, Index=mindex.Index, Wrap=True)
data_5 = Data(item)
jagged = SettingsSpeed()
mesh = MeshBrep(Brep=data_5, Settings=jagged)
mjoin = MeshJoin(Meshes=mesh)
py3 = Python3Script(tree=mjoin)  # -> out, a; inputs tree: tree
# ---------- py3: Python ----------
import Grasshopper as gh
from Grasshopper.Kernel.Data import GH_Path

def make_accumulative_tree(input_tree):
    # Initialize the new output tree
    new_tree = gh.DataTree[object]()
    
    # This list stores everything we've seen so far
    history = []
    
    for i in range(input_tree.BranchCount):
        # 1. Get the current branch path and its new items
        path = input_tree.Path(i)
        new_items = input_tree.Branch(i)
        
        # 2. Add the new items to our growing history
        for item in new_items:
            history.append(item)
        
        # 3. Add a COPY of the history to the new tree at this path
        # We use list(history) so it doesn't just link to the same list
        new_tree.AddRange(list(history), path)
        
    return new_tree

# Output to 'a'
if tree:
    a = make_accumulative_tree(tree)
# ---------- end py3 ----------
number_slider = Slider(1, range=0..4)
lng = ListLength(List=py3.a)  # -> expr("x-1", Length)
split_3 = SplitList(List=py3.a, Index=lng)  # -> simplify(ListA), simplify(ListB)
tstat = TreeStatistics(Tree=mjoin)  # -> Paths, Length, Count
data_6 = Data(split_3.ListA)
data_7 = Data(split_3.ListB)
mjoin_2 = MeshJoin(Meshes=data_6)
series = Series(Start=1, Step=1, Count=tstat.Count)  # -> flatten(Series)
mesh_2 = Mesh(data_7)
concat = Concatenate(FragmentA="00", FragmentB=series)
concat_2 = Concatenate(FragmentA="SEQ::", FragmentB="Part_", FragmentC=concat)
data_8 = Data(concat_2)
bklay = BakeLayers(Layers=data_8, Bake=False)
mesh_3 = Mesh(mesh_2)
volume_2 = Volume(Geometry=mesh_3)  # -> Volume, Centroid
hxl_colour_2 = Data(hxl_colour)
hxl_volume_2 = Integer(hxl_volume)
int_2 = Integer(volume_2.Volume)
panel = Panel("G:\Shared drives\IF2611 - JORAKAY ASA PAVILION (JRK)\04_WORK IN PROGRESS\02_DESIGN DEVELOPMENT\01_MODEL FILES\DOCUMENTATION\3D VISUALIZER\assembly-test-5\assembly-test-5")
equals = Equality(FirstNumber=int_2, SecondNumber=hxl_volume_2)  # -> Equality, Inequality
dispatch_3 = Dispatch(List=hxl_colour_2, DispatchPattern=equals.Equality)  # -> ListA, ListB
txt_3 = Text(panel)
data_9 = Data(dispatch_3.ListA)
rep = ReplaceText(Text=txt_3, Find="\", Replace="/", RecursiveReplace=False)
panel_2 = Panel(rep)

material = CreateMaterial(
    Diffuse=ColourSwatch(SwatchColor=RGB(120, 120, 120)),
    Specular=RGB(255, 255, 255),
    Emission=RGB(0, 0, 0),
    Transparency=0,
    Shine=0)
data_10 = Data(simplify(graft(data_8)))
attributes = DefineObjectAttributes(Layer=data_10, Material=material)
mesh_4 = Mesh(mjoin_2)
bake = BakeObjects(Geometry=mesh_4, Attributes=attributes, Bake=False)

data_11 = Data(data_9)

material_2 = CreateMaterial(Diffuse=data_11, Specular=RGB(255, 255, 255), Emission=RGB(0, 0, 0), Transparency=0, Shine=0)
data_12 = Data(simplify(graft(data_8)))
attributes_2 = DefineObjectAttributes(Layer=data_12, Material=material_2)
mesh_5 = Mesh(mesh_3)
bake_2 = BakeObjects(Geometry=mesh_5, Attributes=attributes_2, Bake=False)

filename = Data("assembly.glb")
run = Data(Button())
folder = Data(panel_2)
py3_2 = Python3Script(run=run, folder=folder, filename=filename)  # -> out, a; inputs run: Boolean, folder: String, filename: String
# ---------- py3_2: Python ----------
import Rhino
import os

def export_assembly_glb():
    # 1. Path Setup
    clean_folder = folder.strip().rstrip("\\").rstrip("/")
    full_path = os.path.join(clean_folder, filename)
    
    # 2. Selection Logic: Grab everything inside layers under "SEQ"
    Rhino.RhinoDoc.ActiveDoc.Objects.UnselectAll()
    
    # Find the parent layer "SEQ"
    parent_layer = Rhino.RhinoDoc.ActiveDoc.Layers.FindName("SEQ")
    
    if parent_layer:
        # Get all sub-layers (Part_001, etc.)
        children = parent_layer.GetChildren()
        if children:
            for layer in children:
                # Select every object on these sub-layers
                objs = Rhino.RhinoDoc.ActiveDoc.Objects.FindByLayer(layer)
                if objs:
                    for obj in objs:
                        obj.Select(True)
    
    # 3. Automated Export Command
    # We force ExportObjectNames=Yes so the web app can "see" Part_001, Part_002
    cmd = (
        f'-_Export "{full_path}" '
        f'ExportObjectNames=Yes '
        f'UseDracoCompression=Yes '
        f'ExportMaterials=Yes '
        f'_Enter _Enter'
    )

    Rhino.RhinoApp.RunScript(cmd, False)
    print(f"Exported to {full_path}")

if run:
    export_assembly_glb()
# ---------- end py3_2 ----------
panel_3 = Panel(py3_2.a)
